# Grasshopper definition sphere.gh (Grasshopper 1.0.7)
# plug-ins: Kangaroo2 Components

ptcount = Slider(44, range=20..120)
radius = Slider(7, range=1..10)
thickness = Slider(0.03, range=0.01..0.1)
scale = Slider(0.6, range=0.1..1)
radius_2 = GetNumber(radius, AtLeast=1, AtMost=1, Maximum=1.797693135e+308, Minimum=-1.797693135e+308, TreeAccess=False)
thickness_2 = GetNumber(thickness, AtLeast=1, AtMost=1, Maximum=1.797693135e+308, Minimum=-1.797693135e+308, TreeAccess=False)
scale_2 = GetNumber(scale, AtLeast=1, AtMost=1, Maximum=1.797693135e+308, Minimum=-1.797693135e+308, TreeAccess=False)
ptcount_2 = GetNumber(ptcount, AtLeast=1, AtMost=1, Maximum=1.797693135e+308, Minimum=-1.797693135e+308, TreeAccess=False)
sphere = Sphere(Base=PlaneXY(0, 0, 0), Radius=radius_2)
bounding_box = BoundingBox(Content=sphere, Plane=PlaneXY(0, 0, 0))  # -> Box, Box_2
populate_geometry = PopulateGeometry(Geometry=sphere, Count=ptcount_2, Seed=1)
voronoi_3d = Voronoi3D(Points=populate_geometry, Box=bounding_box.Box)  # -> Cells, Boundary
brep_brep = BrepBrep(BrepA=sphere, BrepB=voronoi_3d.Cells)  # -> Curves, Points
discontinuity = Discontinuity(Curve=brep_brep.Curves, Level=1)  # -> Points, Parameters
polyline = PolyLine(Vertices=discontinuity.Points, Closed=True)
volume = Volume(Geometry=sphere)  # -> Volume, Centroid
polygon_center = PolygonCenter(Polyline=polyline)  # -> CenterV, CenterE, CenterA
scale_3 = Scale(Geometry=polyline, Center=polygon_center.CenterV, Factor=scale_2)  # -> Geometry, Transform
vector_2pt = Vector2Pt(PointA=polygon_center.CenterV, PointB=volume.Centroid, Unitize=False)  # -> Vector, Length
loft = Loft(
    Curves=[scale_3.Geometry, polyline],
    Options={Adjust=False, Closed=False, LoftEnds=0, LoftSimp=0, LoftType=0, Rebuild=10, Refit=0.01})
multiplication = Multiplication(A=vector_2pt.Vector, B=thickness_2)
extrude = Extrude(Base=loft, Direction=multiplication)
mesh_brep = MeshBrep(
    Brep=extrude,
    Settings={GridMaxCount=0, GridMinCount=16, JaggedSeams=False, MaxEdgeLength=0, MinEdgeLength=0.0001, MinTolerance=0, Refine=True, RefineAngle=0, RelativeTolerance=0.65, SimplePlanes=True, Tolerance=0})
clean = CombineClean(Meshes=mesh_brep)
medges = MeshEdges(Mesh=clean)  # -> NakedEdges, InteriorEdges, NonManifoldEdges

# ---- group: convert lines to curves
crv = Curve([medges.NakedEdges, medges.InteriorEdges])

# ----
mesh = Mesh(clean)
context_bake = ContextBake(Geometry=mesh)
context_bake_2 = ContextBake(Geometry=crv)
