# Grasshopper definition pixel_cube.gh (Grasshopper 1.0.7)

general_transform = Slider(10, range=0..50)
general_transform_2 = GetInteger(general_transform, AtLeast=1, AtMost=1, Maximum=2147483647, Minimum=-2147483648, TreeAccess=False)
rectangle = Rectangle(Plane=PlaneXY(0, 0, 0), XSize=general_transform_2, YSize=general_transform_2, Radius=0)  # -> Rectangle, Length
box_rectangle = BoxRectangle(Rectangle=rectangle.Rectangle, Height=general_transform_2)
x_transform = Slider(10, range=0..50)
z_transform = Slider(10, range=0..50)
y_transform = Slider(10, range=0..50)
volume = Volume(Geometry=box_rectangle)  # -> Volume, Centroid
scale = Scale(Geometry=box_rectangle, Center=volume.Centroid, Factor=Slider(0.99, range=0..1))  # -> Geometry, Transform
y_transform_2 = GetInteger(y_transform, AtLeast=1, AtMost=1, Maximum=2147483647, Minimum=-2147483648, TreeAccess=False)
x_transform_2 = GetInteger(x_transform, AtLeast=1, AtMost=1, Maximum=2147483647, Minimum=-2147483648, TreeAccess=False)
z_transform_2 = GetInteger(z_transform, AtLeast=1, AtMost=1, Maximum=2147483647, Minimum=-2147483648, TreeAccess=False)
box_array = BoxArray(Geometry=scale.Geometry, Cell=box_rectangle, XCount=x_transform_2, YCount=y_transform_2, ZCount=z_transform_2)  # -> Geometry, Transform
seed = Slider(2, range=0..10)
populate_count = Slider(3, range=0..10)
bounding_box = BoundingBox(Content=box_array.Geometry, Plane=PlaneXY(0, 0, 0), UnionBox=True)  # -> Box, Box_2
populate_count_2 = GetInteger(populate_count, AtLeast=1, AtMost=1, Maximum=2147483647, Minimum=-2147483648, TreeAccess=False)
seed_2 = GetInteger(seed, AtLeast=1, AtMost=1, Maximum=2147483647, Minimum=-2147483648, TreeAccess=False)
volume_2 = Volume(Geometry=box_array.Geometry)  # -> Volume, Centroid
populate_geometry = PopulateGeometry(Geometry=bounding_box.Box, Count=populate_count_2, Seed=seed_2)
deconstruct = Slider(54, range=0..100)
closest_point = ClosestPoint(Point=volume_2.Centroid, Cloud=populate_geometry)  # -> ClosestPoint, CPIndex, Distance
deconstruct_2 = GetInteger(deconstruct, AtLeast=1, AtMost=1, Maximum=2147483647, Minimum=-2147483648, TreeAccess=False)
larger_than = LargerThan(FirstNumber=closest_point.Distance, SecondNumber=deconstruct_2)  # -> LargerThan, OrEqualTo
cull_pattern = CullPattern(List=box_array.Geometry, CullPattern=larger_than.LargerThan)
brep = Brep(cull_pattern)
mesh_brep = MeshBrep(
    Brep=brep,
    Settings={GridMaxCount=0, GridMinCount=16, JaggedSeams=False, MaxEdgeLength=0, MinEdgeLength=0.0001, MinTolerance=0, Refine=True, RefineAngle=0, RelativeTolerance=0.65, SimplePlanes=True, Tolerance=0})  # -> flatten(Mesh)

# ---- group: RH_OUT:Final Voxels
geometry = Geometry(mesh_brep)
